vi "PAM.gvi"   [LabVIEW Communications System Design Software 2.0.1]
panel controls:
  "IQ rate": f64 = 1000000
  "carrier frequency": f64 = 915000000
  "gain (dB)": f64
  "active antenna": string = "RX2"
  "number of samples": i64 = 200000
  "Device names": string
  "pulse shaping filter": T2 = "none"
panel indicators:
  "actual IQ rate": f64
  "actual carrier frequency": f64
  "actual gain (dB)": f64
  "error out": error
  "Baseband Output": waveform<c128>
  "Power Spectrum": T1
  "Baseband Output_5": waveform<f64>
  "SNR": f64
types:
  T1 = cluster{"f0": f64, "df": f64, "magnitude": f64[]}
  T2 = enum{"none", "Raised Cosine", "Root Raised Cos", "Gaussian"}
  "Sound Data Format.gtype" = cluster{"sample rate (S/s)": f64, "number of channels": i32, "bits per sample": i32}
uses:
  NI::Analysis::Operations::1D Convolution (DBL).gvi
  NI::Analysis::Conditioning::Map Ranges (1D DBL).gvi
  NI::Analysis::Resampling::Decimate (continuous, DBL).gvi
diagram:
  call "niUSRP Open Rx Session.gvi"(niUSRP Device=$"Device names") -> (error out=w1, session handle out=w2)
  call "niUSRP Configure Signal.gvi"(session handle=w2, IQ rate=$"IQ rate", carrier frequency=$"carrier frequency", gain=$"gain (dB)", error in (no error)=w1, active antenna=$"active antenna") -> (session handle out=w3, coerced IQ rate=w4, coerced carrier frequency=w5, coerced gain=w6, Error Out=w7)
  call "niUSRP Initiate.gvi"(session handle=w3, error in (no error)=w7) -> (session handle out=w8, Error Out=w9)
  call "niUSRP Fetch Rx Data (CDB WDT).gvi"(session handle=w8, number of samples=$"number of samples", error in (no error)=w9) -> (session handle out=w10, data=w11, Error Out=w12)
  Property Node(instance in=w11) -> ("Y"=w13, "dt"=w14)  # Waveform Properties
  Reciprocal(x=w14) -> w15
  Complex To Real Imaginary(x + iy=w13) -> (x=w16)
  call "Chebyshev Filter (CDB).gvi"(filter type="Bandpass", X=w16, sampling freq: fs=w15, high cutoff freq: fh=120000, low cutoff freq: fl=80000) -> (Filtered X=w17)
  Absolute Value(x=w17) -> w18
  call "Mean DBL.gvi"(X=w18) -> (mean=w19)
  Subtract(x=w18, y=w19) -> w20
  call "MT Generate Filter Coefficients.gvi"(pulse shaping filter=$"pulse shaping filter", matched samples per symbol=20, modulation type="PAM") -> (matched filter coefficients=w21)
  call "1D Convolution (DBL).gvi"(x=w20, y=w21) -> (x * y=w22)
  call "Map Ranges (1D DBL).gvi"(signal=w22, pre-scaled low=0.08, pre-scaled high=-0.08) -> (scaled signal=w23)
  call "Decimate (continuous, DBL).gvi"(input array=w23, decimating factor=6) -> (decimated array=w24)
  Math Node("original1"=w24) -> ("reconstructed"=w25, "fs"=w26)
  ~~~
  % Sampling rate
  fs = (22050/6) * 4;
  t_isi = (0:length(original1)-1) / fs;

  % === Echo Delays and Attenuations ===
  delay1_sec = 0.1;
  delay2_sec = 0.4;
  atten1 = 0.6;
  atten2 = 0.5;

  delay1 = round(fs * delay1_sec);
  delay2 = round(fs * delay2_sec);

  % ISI signal
  isi_signal = original1;

  % === EQUALIZER: Inverse Filter ===
  b = 1;  % Numerator
  a = [1, zeros(1, delay1-1), atten1, zeros(1, delay2 - delay1 - 1), atten2];
  reconstructed = filter(b, a, original1);
  reconstructed = reconstructed / max(abs(reconstructed));
  ~~~
  call "Chebyshev Filter (CDB).gvi"(filter type="Bandpass", X=w25, sampling freq: fs=w26, high cutoff freq: fh=1000, low cutoff freq: fl=100, order=4) -> (Filtered X=w27)
  call "SNR.gvi"(decimated array=w24, Filtered X=w27) -> (SNR=w28)
  $SNR <- w28
  Reciprocal(x=w26) -> w29
  w30 = cluster{"t0": timestamp, "dt": f64, "Y": c128[]} {all zero or empty}
  Property Node(instance in=w30, "Y"=w27, "dt"=w29) -> (instance out=w31)
  call "FFT Power Spectrum for 1 Chan (CDB)2.gvi"(time signal=w31) -> (power spectrum=w32)
  $"Power Spectrum" <- w32
  Build Waveform Node(Y=w27, dt=w29) -> (output waveform=w33)
  $"Baseband Output" <- w33
  w34 = "Sound Data Format.gtype" {"sample rate (S/s)"=14700, "number of channels"=1, "bits per sample"=16}
  Property Node(instance in=w34) -> ("sample rate (S/s)"=w35)
  Multiply(5, w35) -> w36
  call "Sound Output Configure.gvi"(device ID=1, sound format=w34, number of samples/ch=w36) -> (task ID=w37, error out=w38)
  call "Sound Output Start.gvi"(task ID in=w37, error in=w38) -> (task ID out=w39, error out=w40)
  Build Array(w33) -> w41
  call "Sound Output Write.gvi"(task ID in=w39, data=w41, error in=w40) -> (task ID out=w42, error out=w43)
  call "Sound Output Wait.gvi"(task ID in=w42, timeout=5) -> (task ID out=w44)
  call "Sound Output Start.gvi"(task ID in=w44, error in=w43)
  Reciprocal(x=88200) -> w45
  Build Waveform Node(Y=w23, dt=w45) -> (output waveform=w46)
  $"Baseband Output_5" <- w46
  $"actual IQ rate" <- w4
  call "niUSRP Abort.gvi"(Handle in=w10, error in (no error)=w12) -> (Handle out=w47, Error Out=w48)
  call "niUSRP Close Session.gvi"(handle in=w47, error in=w48) -> (error out=w49)
  call "Simple Error Handler.gvi"(error in=w49) -> (error out=w50)
  $"error out" <- w50
  $"actual carrier frequency" <- w5
  $"actual gain (dB)" <- w6
