vi "PAM_echo.gvi"   [LabVIEW Communications System Design Software 2.0.1]
panel controls:
  "IQ rate": f64 = 1000000
  "carrier frequency": f64 = 915000000
  "gain (dB)": f64
  "active antenna": string = "RX2"
  "number of samples": i64 = 200000
  "Device names": string
  "pulse shaping filter": T2 = "none"
panel indicators:
  "actual IQ rate": f64
  "actual carrier frequency": f64
  "actual gain (dB)": f64
  "error out": error
  "Baseband Output": waveform<f64>
  "Power Spectrum": T1
types:
  T1 = cluster{"f0": f64, "df": f64, "magnitude": f64[]}
  T2 = enum{"none", "Raised Cosine", "Root Raised Cos", "Gaussian"}
  "Sound Data Format.gtype" = cluster{"sample rate (S/s)": f64, "number of channels": i32, "bits per sample": i32}
uses:
  NI::Analysis::Operations::1D Convolution (DBL).gvi
  NI::Analysis::Conditioning::Map Ranges (1D DBL).gvi
  NI::Analysis::Resampling::Decimate (continuous, DBL).gvi
diagram:
  call "niUSRP Open Rx Session.gvi"(niUSRP Device=$"Device names") -> (error out=w1, session handle out=w2)
  call "niUSRP Configure Signal.gvi"(session handle=w2, IQ rate=$"IQ rate", carrier frequency=$"carrier frequency", gain=$"gain (dB)", error in (no error)=w1, active antenna=$"active antenna") -> (session handle out=w3, coerced IQ rate=w4, coerced carrier frequency=w5, coerced gain=w6, Error Out=w7)
  call "niUSRP Initiate.gvi"(session handle=w3, error in (no error)=w7) -> (session handle out=w8, Error Out=w9)
  call "niUSRP Fetch Rx Data (CDB WDT).gvi"(session handle=w8, number of samples=$"number of samples", error in (no error)=w9) -> (session handle out=w10, data=w11, Error Out=w12)
  Property Node(instance in=w11) -> ("Y"=w13, "dt"=w14)  # Waveform Properties
  Reciprocal(x=w14) -> w15
  Complex To Real Imaginary(x + iy=w13) -> (x=w16)
  call "Chebyshev Filter (CDB).gvi"(filter type="Bandpass", X=w16, sampling freq: fs=w15, high cutoff freq: fh=120000, low cutoff freq: fl=80000) -> (Filtered X=w17)
  Absolute Value(x=w17) -> w18
  call "Mean DBL.gvi"(X=w18) -> (mean=w19)
  Subtract(x=w18, y=w19) -> w20
  call "MT Generate Filter Coefficients.gvi"(pulse shaping filter=$"pulse shaping filter", matched samples per symbol=20, modulation type="PAM") -> (matched filter coefficients=w21)
  call "1D Convolution (DBL).gvi"(x=w20, y=w21) -> (x * y=w22)
  call "Map Ranges (1D DBL).gvi"(signal=w22, pre-scaled low=0.08, pre-scaled high=-0.08) -> (scaled signal=w23)
  call "Decimate (continuous, DBL).gvi"(input array=w23, decimating factor=6) -> (decimated array=w24)
  Reciprocal(x=14700) -> w25
  w26 = cluster{"t0": timestamp, "dt": f64, "Y": c128[]} {all zero or empty}
  Property Node(instance in=w26, "Y"=w24, "dt"=w25) -> (instance out=w27)
  call "FFT Power Spectrum for 1 Chan (CDB)2.gvi"(time signal=w27) -> (power spectrum=w28)
  $"Power Spectrum" <- w28
  Build Waveform Node(Y=w24, dt=w25) -> (output waveform=w29)
  $"Baseband Output" <- w29
  Build Array(w29) -> w30
  w31 = "Sound Data Format.gtype" {"sample rate (S/s)"=14700, "number of channels"=1, "bits per sample"=16}
  Property Node(instance in=w31) -> ("sample rate (S/s)"=w32)
  Multiply(5, w32) -> w33
  call "Sound Output Configure.gvi"(device ID=1, sound format=w31, number of samples/ch=w33) -> (task ID=w34, error out=w35)
  call "Sound Output Start.gvi"(task ID in=w34, error in=w35) -> (task ID out=w36, error out=w37)
  call "Sound Output Write.gvi"(task ID in=w36, data=w30, error in=w37) -> (task ID out=w38, error out=w39)
  call "Sound Output Wait.gvi"(task ID in=w38, timeout=5) -> (task ID out=w40)
  call "Sound Output Start.gvi"(task ID in=w40, error in=w39)
  $"actual IQ rate" <- w4
  call "niUSRP Abort.gvi"(Handle in=w10, error in (no error)=w12) -> (Handle out=w41, Error Out=w42)
  call "niUSRP Close Session.gvi"(handle in=w41, error in=w42) -> (error out=w43)
  call "Simple Error Handler.gvi"(error in=w43) -> (error out=w44)
  $"error out" <- w44
  $"actual carrier frequency" <- w5
  $"actual gain (dB)" <- w6
