vi "SNR.gvi"   [LabVIEW Communications System Design Software 2.0.1]
inputs:
  "decimated array": f64[]
  "Filtered X": c128[]
outputs:
  "SNR": f64
uses:
  NI::Analysis::Conditioning::Normalize Range (1D DBL).gvi
  NI::Analysis::Statistics::Mean (DBL).gvi
diagram:
  call "Normalize Range (1D DBL).gvi"(signal=$"decimated array", scaled low=0, scaled high=1) -> (scaled signal=w1)
  Is Greater(x=w1, y=0) -> w2
  for {
    w3 = each element of w2
    w4 = each element of w1
    Select(s=w3, t=w4, f=0) -> w6
    append w6 to w5
  }
  Multiply(w5, w5) -> w7
  Absolute Value(x=$"Filtered X") -> w8
  Subtract(x=w5, y=w8) -> w9
  Multiply(w9, w9) -> w10
  Divide(x=w7, y=w10) -> w11
  call "Mean (DBL).gvi"(x=w11) -> (mean=w12)
  Logarithm Base 10(x=w12) -> w13
  Multiply(10, w13) -> w14
  $SNR <- w14
