vi "Echo_generator.gvi"   [LabVIEW Communications System Design Software 2.0.1]
inputs:
  "Y": f64[]
  "message length (samples)": f64 = 200000
outputs:
  "message Signal(analog)_2": f64[]
  "Variable: data1": f64[]
uses:
  NI::Analysis::Conditioning::Shift Array.gvi
diagram:
  Multiply(0.4, $"message length (samples)") -> w1
  Round To Nearest(number=w1) -> w2
  call "Shift Array.gvi"(input array=$Y, number of shifts=w2) -> (shifted array=w3)
  Multiply(w3, 0.5) -> w4
  Multiply(0.1, $"message length (samples)") -> w5
  Round To Nearest(number=w5) -> w6
  call "Shift Array.gvi"(input array=$Y, number of shifts=w6) -> (shifted array=w7)
  Multiply(w7, 0.6) -> w8
  Add(w8, w4) -> w9
  Add(w9, $Y) -> w10
  $"Variable: data1" <- w10
  Math Node("original"=$Y, "fs"=$"message length (samples)") -> ("isi_signal"=w11)
  ~~~
  % Parameters
  delay1_sec = 0.1;
  delay2_sec = 0.4;
  atten1 = 0.6;
  atten2 = 0.5;

  % Force column vector
  original = original(:);
  % Calculate delays
  delay1 = round(fs * delay1_sec);
  delay2 = round(fs * delay2_sec);

  N = length(original);

  % Create echoes with safe padding
  echo1 = zeros(N, 1);
  if delay1 < N
      echo1(delay1+1:end) = original(1:end-delay1) * atten1;
  end

  echo2 = zeros(N, 1);
  if delay2 < N
      echo2(delay2+1:end) = original(1:end-delay2) * atten2;
  end

  % Final ISI signal
  isi_signal = original + echo1 + echo2;
  ~~~
  Reshape Array(inArray=w11, size=2) -> w12
  $"message Signal(analog)_2" <- w12
