vi "Mic.gvi"   [LabVIEW Communications System Design Software 2.0.1]
inputs:
  "Duration": f64
  "sound format_2": "Sound Data Format.gtype" = {"sample rate (S/s)"=22050, "number of channels"=2, "bits per sample"=16}
outputs:
  "message Signal(analog)": waveform<f64>[]
types:
  "Sound Data Format.gtype" = cluster{"sample rate (S/s)": f64, "number of channels": i32, "bits per sample": i32}
diagram:
  Property Node(instance in=$"sound format_2") -> ("sample rate (S/s)"=w1)
  Multiply($Duration, w1) -> w2
  call "Sound Input Configure.gvi"(device ID=0, sound format=$"sound format_2", sample mode="Continuous Samples"(1), number of samples/ch=w2) -> (task ID=w3, error out=w4)
  call "Sound Input Start.gvi"(task ID in=w3, error in=w4) -> (task ID out=w5, error out=w6)
  call "Sound Input Read.gvi"(task ID in=w5, error in=w6, number of samples/ch=w2) -> (task ID out=w7, data=w8, error out=w9)
  $"message Signal(analog)" <- w8
  Array Index(array=w8) -> (out0[_]=w10)
  Property Node(instance in=w10)  # Waveform Properties
  call "Sound Input Stop.gvi"(task ID in=w7, error in=w9) -> (task ID out=w11, error out=w12)
  call "Sound Input Clear.gvi"(task ID=w11, error in=w12)
