vi "PAM.gvi"   [LabVIEW Communications System Design Software 2.0.1]
panel controls:
  "IQ rate": f64 = 200000
  "carrier frequency": f64 = 915100000
  "gain (dB)": f64
  "active antenna": string = "TX1"
  "Device names": string = "192.168.10.2"
  "stop": bool
  "pulse shaping filter": T1 = "none"
  "pulse shaping samples per symbol": i32 = 16
  "sound format": "Sound Data Format.gtype" = {"sample rate (S/s)"=22050, "number of channels"=2, "bits per sample"=16}
  "Duration": f64
panel indicators:
  "actual IQ rate": f64
  "actual carrier frequency": f64
  "actual gain (dB)": f64
  "error out": error
  "message Signal after sampling it": waveform<f64>
  "output signal with PAM modulation": waveform<f64>
  "message Signal(echo)": waveform<f64>
  "message Signal(no echo)": waveform<f64>
types:
  T1 = enum{"none", "Raised Cosine", "Root Raised Cos", "Gaussian"}
  "Sound Data Format.gtype" = cluster{"sample rate (S/s)": f64, "number of channels": i32, "bits per sample": i32}
uses:
  NI::Analysis::Conditioning::Normalize Range (1D DBL).gvi
  NI::Analysis::Resampling::Upsample (DBL).gvi
  NI::Analysis::Operations::1D Convolution (DBL).gvi
diagram:
  call "Mic.gvi"(Duration=$Duration, sound format_2=$"sound format") -> (message Signal(analog)=w1)
  Array To Cluster[NumberOfClusterElements=9](array=w1) -> (cluster=w2)
  Property Node(instance in=w2) -> ("Element 0"=w3)
  Property Node(instance in=w3) -> ("Y"=w4, "dt"=w5)
  Reciprocal(x=w5) -> w6
  call "Echo_generator.gvi"(Y=w4, message length (samples)=w6) -> (Variable: data1=w7)
  Build Waveform Node(Y=w7, dt=w5) -> (output waveform=w8)
  $"message Signal(echo)" <- w8
  Math Node("data1"=w7) -> ("wave_down"=w9)
  ~~~
  % Inputs to the MathScript Node
  % data1: original signal (1D array)
  % t: time vector (1D array)
  % fs_original: original sampling frequency (scalar)
  fs_original = 22050;
  fs_down = 6000;
  N = length(data1);
  ts_original = 1/fs_original;                           % Target sampling rate
  factor = round(fs_original / fs_down);      % Downsampling factor
  t = (0:N-1) * ts_original;   % Time vector for 144 samples             % Number of samples
  idx = 1:factor:N;                           % Indices for downsampling

  wave_down = data1(idx);
  wave_down =wave_down+1;                     % Downsampled signal
  t_down = t(idx);                            % Corresponding time values

  % Outputs from the MathScript Node
  % wave_down, t_down
  ~~~
  call "Normalize Range (1D DBL).gvi"(signal=w9, scaled low=0) -> (scaled signal=w10)
  Reciprocal(x=6000) -> w11
  Build Waveform Node(Y=w10, dt=w11) -> (output waveform=w12)
  $"message Signal after sampling it" <- w12
  call "Upsample (DBL).gvi"(input array=w10, upsampling factor=$"pulse shaping samples per symbol") -> (upsampled array=w13)
  call "MT Generate Filter Coefficients.gvi"(pulse shaping filter=$"pulse shaping filter", pulse shaping samples per symbol=$"pulse shaping samples per symbol", modulation type="PAM") -> (pulse shaping filter coefficients=w14)
  call "1D Convolution (DBL).gvi"(x=w13, y=w14) -> (x * y=w15)
  Reciprocal(x=12000) -> w16
  Build Waveform Node(Y=w15, dt=w16) -> (output waveform=w17)
  $"output signal with PAM modulation" <- w17
  Build Waveform Node(Y=w4, dt=w5) -> (output waveform=w18)
  $"message Signal(no echo)" <- w18
  call "niUSRP Open Tx Session.gvi"(Device names=$"Device names") -> (session handle out=w19, Error Out=w20)
  call "niUSRP Configure Signal.gvi"(session handle=w19, IQ rate=$"IQ rate", carrier frequency=$"carrier frequency", gain=$"gain (dB)", error in (no error)=w20, active antenna=$"active antenna") -> (session handle out=w21, coerced IQ rate=w22, coerced carrier frequency=w23, coerced gain=w24, Error Out=w25)
  while {
    call "niUSRP Write Tx Data (CDB).gvi"(session handle=w21, data=w17, end of data?=$stop, error in (no error)=w25) -> (session handle out=w26, Error Out=w27)
    Logical Or(w27, $stop) -> w28
    stop if w28
  }
  call "niUSRP Close Session.gvi"(handle in=w26, error in=w27) -> (error out=w29)
  call "Simple Error Handler.gvi"(error in=w29) -> (error out=w30)
  $"error out" <- w30
  $"actual IQ rate" <- w22
  $"actual carrier frequency" <- w23
  $"actual gain (dB)" <- w24
